# Dynamo graph dynamicSectionView.dyn (Dynamo 1.2.1.3083)

code_block = CodeBlock { "C:\Dynamo\ViewRange\\test_views\\slice"; 1; "Scope Box 3"; "3d Print"; false; }
categories = Categories("VolumeOfInterest")
all_elements_of_category = ElementsOfCategory(categories)
name = Element.Name(all_elements_of_category)
eq = name == code_block.out2
filterByBoolMask = List.FilterByBoolMask(list=all_elements_of_category, mask=eq)
code_block_2 = CodeBlock(x=filterByBoolMask.in) { x[0]; }
dynamicsectionview_python_script = Python(IN[0]=code_block.out0, IN[1]=code_block.out1, IN[2]=code_block_2, IN[3]=code_block.out3, IN[4]=code_block.out4)
# ---------- dynamicsectionview_python_script.python (149 lines) ----------
import clr
clr.AddReference('ProtoGeometry')
from Autodesk.DesignScript.Geometry import *

# Import Element wrapper extension methods
clr.AddReference('RevitNodes')
import Revit
clr.ImportExtensions(Revit.Elements)

# Import geometry conversion extension methods
clr.ImportExtensions(Revit.GeometryConversion)

# Import DocumentManager and TransactionManager
clr.AddReference('RevitServices')
import RevitServices
from RevitServices.Persistence import DocumentManager
from RevitServices.Transactions import TransactionManager

# Import RevitAPI
clr.AddReference('RevitAPI')
import Autodesk
from Autodesk.Revit.DB import *
from Autodesk.Revit.DB import FilteredElementCollector as _FilteredElementCollector
from Autodesk.Revit.DB import ViewFamilyType as _ViewFamilyType

import System
from System import Array
from System.Collections.Generic import *

import sys


def get_ViewFamilyTypeId(viewFamilyTypeName):	
	names = []
	ids = []
	viewFamilyTypeId = -1
	collector = _FilteredElementCollector(doc).OfClass(_ViewFamilyType) #collecting all elements of type ViewFamilyType
	for t in collector:
		names.append(t.FamilyName)
		ids.append(t.Id)
		if t.FamilyName == viewFamilyTypeName:
			viewFamilyTypeId = t.Id
			break # get the first
	return viewFamilyTypeId
			
			
def create_view(doc, viewFamilyTypeId, boundingBox):			
	if viewFamilyTypeId != -1:
		TransactionManager.Instance.EnsureInTransaction(doc)	
		sectionView = ViewSection.CreateDetail(doc, viewFamilyTypeId, boundingBox) # http://www.revitapidocs.com/2016/834e7154-b2f0-ffcd-b04a-9ad8cee321c8.htm
		TransactionManager.Instance.TransactionTaskDone()
		return sectionView


def export_view_images(viewIds, path, pixel_size, doc):
	TransactionManager.Instance.EnsureInTransaction(doc)
	ieo = ImageExportOptions()
	ieo.ExportRange = ExportRange.SetOfViews
	ieo.SetViewsAndSheets(viewIds)
	ieo.FilePath = path	
	ieo.HLRandWFViewsFileType = ImageFileType.PNG
	ieo.ShadowViewsFileType = ImageFileType.PNG
	ieo.PixelSize = pixel_size
	doc.ExportImage(ieo)
	TransactionManager.Instance.TransactionTaskDone()
	
	
def delete_views(doc, views):
	TransactionManager.Instance.EnsureInTransaction(doc)	
	for view in views:
		doc.Delete(view.Id)
	TransactionManager.Instance.TransactionTaskDone()


def scopeBox2cropBox(scopeBox, viewFamilyTypeId, boundingBox, height):
	TransactionManager.Instance.EnsureInTransaction(doc)
	if height >= 0:
		boundingBox.Min = XYZ(boundingBox.Min.X, boundingBox.Min.Y, min(height, boundingBox.Max.Z))
	sectionView = ViewSection.CreateDetail(doc, viewFamilyTypeId, boundingBox) # http://www.revitapidocs.com/2016/834e7154-b2
	param = sectionView.get_Parameter(BuiltInParameter.VIEWER_VOLUME_OF_INTEREST_CROP)
	param.Set(scopeBox.Id)
	TransactionManager.Instance.TransactionTaskDone()
	return sectionView, sectionView.CropBox


def apply_viewTemplate(doc, view, viewTemplateName):
	viewTemplate = None
	collector = FilteredElementCollector(doc).OfClass(View)
	for i in collector:
		if i.IsTemplate == True and i.Name == viewTemplateName:
			viewTemplate = i
	
	TransactionManager.Instance.EnsureInTransaction(doc)
	if viewTemplate is not None:
		view.ViewTemplateId = viewTemplate.Id
	TransactionManager.Instance.TransactionTaskDone()


filePath = IN[0]
voxel_size = IN[1]
scopeBox = UnwrapElement(IN[2])
viewTemplateName = IN[3]
keep_views = IN[4]
doc = DocumentManager.Instance.CurrentDBDocument

views = []
viewIds = []
viewNames = []
try:
	pre_i = 0 # slow issue: delete the first picture
	pre_j = 0
	count = -1
	
	viewFamilyTypeId = get_ViewFamilyTypeId("Detail View")
	boundingBox = scopeBox.get_BoundingBox(None) # https://github.com/DynamoDS/DynamoRevit/blob/Revit2015/src/Libraries/RevitNodes/Elements/Element.cs
	sectionView, cropBox = scopeBox2cropBox(scopeBox, viewFamilyTypeId, boundingBox, -1)
	apply_viewTemplate(doc, sectionView, viewTemplateName)
	
	minPoint = cropBox.Min
	maxPoint = cropBox.Max
	bottom = minPoint.Z
	top = maxPoint.Z
	height = 0
	digit = len(str(int((top - bottom) / voxel_size))) 
	pixel_size = (boundingBox.Max.X - boundingBox.Min.X) * 12 * voxel_size
	
	while height + bottom < top:
		if count > 5:
			break
	
		height += voxel_size
		sectionView_t, cropBox_t = scopeBox2cropBox(scopeBox, viewFamilyTypeId, boundingBox, height)
		apply_viewTemplate(doc, sectionView_t, viewTemplateName)
		
		views.append(sectionView_t)
		viewIds.append(sectionView_t.Id)
		viewNames.append(sectionView_t.ViewName)
		count += 1
		
	TransactionManager.Instance.ForceCloseTransaction() # Dynamo transaction force close order
	imageName = filePath #/ + str(count).rjust(digit)
	export_view_images(viewIds, imageName, pixel_size, doc)
	
	if keep_views == False: # input all as string
			delete_views(doc, views)
			
	OUT = "succeed", sectionView, bottom, top
except Exception as e:
	OUT =  "failed", e
# ----------------------------------------
